# Grasshopper definition ShelvingFinal.gh (Grasshopper 1.0.8)

# ---- group: Triangles for 3D Print
shelf_width = Slider(14, range=0..100)
number_of_triangles = Slider(3, range=0..20)
shelf_depth = Slider(18, range=0..100)
material_thickness = Slider(2.1, range=0.1..5)
xy_plane = XYPlane(Origin=Point(0, 0, 0))
unit_z = UnitZ(Factor=material_thickness)
rectangle = Rectangle(Plane=xy_plane, XSize=shelf_width, YSize=shelf_depth, Radius=0)  # -> Rectangle, Length
addition = Addition(A=shelf_width, B=Slider(3, range=0..10))
extrude = Extrude(Base=rectangle.Rectangle, Direction=unit_z)
multiplication = Multiplication(A=number_of_triangles, B=Slider(3, range=0..10))
series = Series(Start=0, Step=addition, Count=multiplication)
cap_holes = CapHoles(Brep=extrude)
unit_x = UnitX(Factor=series)
move = Move(Geometry=cap_holes, Motion=unit_x)  # -> Geometry, Transform
brep = Brep(move.Geometry)

shelf_width_2 = Slider(152.4, range=0..200)
number_of_triangles_2 = Slider(3, range=0..20)
shelf_depth_2 = Slider(152.4, range=0..200)
material_thickness_2 = Slider(7, range=0.1..10.1)
xy_plane_2 = XYPlane(Origin=Point(0, 0, 0))
rectangle_2 = Rectangle(Plane=xy_plane_2, XSize=shelf_width_2, YSize=shelf_depth_2, Radius=0)  # -> Rectangle, Length
unit_z_2 = UnitZ(Factor=material_thickness_2)
addition_2 = Addition(A=shelf_width_2, B=Slider(3, range=0..10))
extrude_2 = Extrude(Base=rectangle_2.Rectangle, Direction=unit_z_2)
multiplication_2 = Multiplication(A=number_of_triangles_2, B=Slider(3, range=0..10))
series_2 = Series(Start=0, Step=addition_2, Count=multiplication_2)
cap_holes_2 = CapHoles(Brep=extrude_2)
unit_x_2 = UnitX(Factor=series_2)
move_2 = Move(Motion=unit_x_2)  # -> Geometry, Transform
brep_2 = Brep(move_2.Geometry)

# ---- group: Triangles for laser cut
shelf_width_3 = Slider(9, range=0..100)
number_of_triangles_3 = Slider(4, range=0..20)
shelf_depth_3 = Slider(20, range=0..100)
material_thickness_3 = Slider(0.6, range=0.1..5)
construct_point = ConstructPoint(XCoordinate=0, YCoordinate=Slider(40, range=0..100), ZCoordinate=0)
unit_z_3 = UnitZ(Factor=material_thickness_3)
xy_plane_3 = XYPlane(Origin=construct_point)
addition_3 = Addition(A=shelf_width_3, B=Slider(5, range=0..10))
rectangle_3 = Rectangle(Plane=xy_plane_3, XSize=shelf_width_3, YSize=shelf_depth_3, Radius=0)  # -> Rectangle, Length
multiplication_3 = Multiplication(A=number_of_triangles_3, B=Slider(3, range=0..10))
series_3 = Series(Start=0, Step=addition_3, Count=multiplication_3)
unit_x_3 = UnitX(Factor=series_3)
move_3 = Move(Geometry=rectangle_3.Rectangle, Motion=unit_x_3)  # -> Geometry, Transform
brep_3 = Brep(move_3.Geometry)

# ----
addition_4 = Addition(A=shelf_depth_2, B=Slider(5, range=0..10))
negative = Negative(Value=addition_4)
unit_y = UnitY(Factor=negative)
xz_plane = XZPlane(Origin=Point(0, 0, 0))
move_4 = Move(Geometry=cap_holes_2, Motion=unit_y)  # -> Geometry, Transform
number_slider = Slider(0, range=0..100)
rotate = Rotate(Angle=Slider(120, range=0..360), Plane=xz_plane)  # -> Geometry, Transform
xz_plane_2 = XZPlane(Origin=Point(0, 0, 0))
rotate_2 = Rotate(Geometry=move_4.Geometry, Angle=Slider(4.188, range=0..10), Plane=xz_plane_2)  # -> Geometry, Transform
rotate_3 = Rotate(Geometry=move_4.Geometry, Angle=Slider(0, range=0..100), Plane=xz_plane_2)  # -> Geometry, Transform
rotate_4 = Rotate(Geometry=move_4.Geometry, Angle=Slider(2.094, range=0..10), Plane=xz_plane_2)  # -> Geometry, Transform
division = Division(A=shelf_width_2, B=Slider(1.732, range=0..10))
xz_plane_3 = XZPlane(Origin=Point(0, 0, 0))
polygon = Polygon(Plane=xz_plane_3, Radius=division, Segments=Slider(3, range=0..10), FilletRadius=0)  # -> Polygon, Length
rotate_5 = Rotate(Geometry=polygon.Polygon, Angle=1.570796327, Plane=xz_plane_3)  # -> Geometry, Transform
deconstruct_brep = DeconstructBrep(Brep=rotate_5.Geometry)  # -> Faces, Edges, Vertices
multiplication_4 = Multiplication(A=material_thickness_2, B=Slider(4, range=0..10))
list_item = ListItem(List=deconstruct_brep.Vertices, Index=Slider(0, range=0..100), Wrap=True)
list_item_2 = ListItem(List=deconstruct_brep.Vertices, Index=Slider(2, range=0..10), Wrap=True)
list_item_3 = ListItem(List=deconstruct_brep.Vertices, Index=Slider(1, range=0..1), Wrap=True)

# ---- group: Making triangle
move_5 = Move(Geometry=rotate_2.Geometry, Motion=list_item)  # -> Geometry, Transform
move_6 = Move(Geometry=rotate_4.Geometry, Motion=list_item_2)  # -> Geometry, Transform
move_7 = Move(Geometry=rotate_3.Geometry, Motion=list_item_3)  # -> Geometry, Transform
deconstruct_brep_2 = DeconstructBrep(Brep=move_5.Geometry)  # -> Faces, Edges, Vertices
evaluate_surface = EvaluateSurface(Surface=deconstruct_brep_2.Faces, Point=deconstruct_brep_2.Vertices)  # -> Point, Normal, UDirection, VDirection, Frame
deconstruct_brep_3 = DeconstructBrep(Brep=move_6.Geometry)  # -> Faces, Edges, Vertices
evaluate_surface_2 = EvaluateSurface(Surface=deconstruct_brep_3.Faces, Point=deconstruct_brep_3.Vertices)  # -> Point, Normal, UDirection, VDirection, Frame
list_item_4 = ListItem(List=evaluate_surface.Normal, Index=Slider(5, range=0..10), Wrap=True)
panel = Panel(list_item_4)
negative_2 = Negative(Value=material_thickness_2)
list_item_5 = ListItem(List=evaluate_surface_2.Normal, Index=Slider(5, range=0..10), Wrap=True)
unit_z_4 = UnitZ(Factor=negative_2)
amplitude = Amplitude(Vector=list_item_5, Amplitude=material_thickness_2)
amplitude_2 = Amplitude(Vector=list_item_4, Amplitude=material_thickness_2)
move_8 = Move(Geometry=move_6.Geometry, Motion=amplitude)  # -> Geometry, Transform
move_9 = Move(Geometry=move_7.Geometry, Motion=unit_z_4)  # -> Geometry, Transform
move_10 = Move(Geometry=move_5.Geometry, Motion=amplitude_2)  # -> Geometry, Transform

# ----
rectangle_4 = Rectangle(Plane=list_item, XSize=multiplication_4, YSize=multiplication_4, Radius=0)  # -> Rectangle, Length
rectangle_5 = Rectangle(Plane=list_item_2, XSize=multiplication_4, YSize=multiplication_4, Radius=0)  # -> Rectangle, Length
rectangle_6 = Rectangle(Plane=list_item_3, XSize=multiplication_4, YSize=multiplication_4, Radius=0)  # -> Rectangle, Length
unit_z_5 = UnitZ(Factor=multiplication_4)
extrude_3 = Extrude(Base=rectangle_4.Rectangle, Direction=unit_z_5)
extrude_4 = Extrude(Base=rectangle_6.Rectangle, Direction=unit_z_5)
extrude_5 = Extrude(Base=rectangle_5.Rectangle, Direction=unit_z_5)
division_2 = Division(A=unit_z_5, B=Slider(2, range=0..10))
negative_3 = Negative(Value=division_2)
move_11 = Move(Geometry=extrude_4, Motion=negative_3)  # -> Geometry, Transform
move_12 = Move(Geometry=extrude_5, Motion=negative_3)  # -> Geometry, Transform
move_13 = Move(Geometry=extrude_3, Motion=negative_3)  # -> Geometry, Transform
unit_x_4 = UnitX(Factor=negative_3)
negative_4 = Negative(Value=unit_x_4)
move_14 = Move(Geometry=move_13.Geometry, Motion=negative_4)  # -> Geometry, Transform
move_15 = Move(Geometry=move_12.Geometry, Motion=negative_4)  # -> Geometry, Transform
move_16 = Move(Geometry=move_11.Geometry, Motion=negative_4)  # -> Geometry, Transform
unit_y_2 = UnitY(Factor=Slider(13, range=0..15))
negative_5 = Negative(Value=unit_y_2)
move_17 = Move(Geometry=move_14.Geometry, Motion=negative_5)  # -> Geometry, Transform
move_18 = Move(Geometry=move_15.Geometry, Motion=negative_5)  # -> Geometry, Transform
move_19 = Move(Geometry=move_16.Geometry, Motion=negative_5)  # -> Geometry, Transform
cap_holes_3 = CapHoles(Brep=move_17.Geometry)
cap_holes_4 = CapHoles(Brep=move_19.Geometry)
cap_holes_5 = CapHoles(Brep=move_18.Geometry)
solid_difference = SolidDifference(BrepsA=cap_holes_4, BrepsB=move_10.Geometry)
solid_difference_2 = SolidDifference(BrepsA=cap_holes_3, BrepsB=move_8.Geometry)
solid_difference_3 = SolidDifference(BrepsA=cap_holes_5, BrepsB=move_9.Geometry)
solid_difference_4 = SolidDifference(BrepsA=solid_difference_2, BrepsB=move_10.Geometry)
solid_difference_5 = SolidDifference(BrepsA=solid_difference, BrepsB=move_9.Geometry)
solid_difference_6 = SolidDifference(BrepsA=solid_difference_3, BrepsB=move_8.Geometry)
unit_z_6 = UnitZ(Factor=Slider(100, range=0..100))
move_20 = Move(Geometry=solid_difference_4, Motion=unit_z_6)  # -> Geometry, Transform
move_21 = Move(Geometry=solid_difference_5, Motion=unit_z_6)  # -> Geometry, Transform
move_22 = Move(Geometry=solid_difference_6, Motion=unit_z_6)  # -> Geometry, Transform
